# Dynamo graph StandardBenchmarkGraph.dyn
# Standard Self-Contained Benchmark Graph (5 Nodes, 4 Wires, 0 External Dependencies)

codeBlockNodeModel = CodeBlockNodeModel(CodeText="""x = 1000;
y = 2000;""", X=100, Y=100)
byCoordinates = Point.ByCoordinates(x=codeBlockNodeModel.x, y=codeBlockNodeModel.y, X=300, Y=100)
ZAxis = Vector.ZAxis(X=300, Y=250)
byStartPointDirectionLength = Line.ByStartPointDirectionLength(startPoint=byCoordinates, direction=ZAxis, X=550, Y=150)
watch = Watch(X=800, Y=150)  # unwired: arg0
