# Dynamo graph VeHeDamTang1_DaKieng.dyn (Dynamo 3.2.1.5342)
# author: Antigravity & HP Dynamo MCP
# Đồ thị trực quan tự động dựng toàn bộ 295 cấu kiện dầm sàn/đà kiềng Tầng 1 từ bản vẽ CAD (đầy đủ đầu vào File Path, tự động nối liên hoàn 24 dây nối giữa 21 nodes).

# group: 1. ĐẦU VÀO DỮ LIỆU TỪ CAD (FILE PATH & EXTRACTORS)
file_path_cad_json_model = Filename("g:\09-PROJECT AI\01_Revit\02_CshapRevit\01_AddinRebar\scratch\story1_grade_beams_model.json")  # graph input
n1_tạo_295_điểm_đầu_start_points = Python(IN[0]=file_path_cad_json_model)  # "1. Tạo 295 Điểm Đầu (Start Points)"; CPython3
# ---------- n1_tạo_295_điểm_đầu_start_points.python (15 lines) ----------
# -*- coding: utf-8 -*-
import json, clr
clr.AddReference('ProtoGeometry')
from Autodesk.DesignScript.Geometry import Point

file_path = IN[0]
with open(file_path, 'r', encoding='utf-8') as f:
    data = json.load(f)

pts = []
for b in data.get('beams', []):
    x = float(b['StartX']) / 304.8
    y = float(b['StartY']) / 304.8
    pts.append(Point.ByCoordinates(x, y, 0.0))
OUT = pts
# ----------------------------------------
n2_tạo_295_điểm_cuối_end_points = Python(IN[0]=file_path_cad_json_model)  # "2. Tạo 295 Điểm Cuối (End Points)"; CPython3
# ---------- n2_tạo_295_điểm_cuối_end_points.python (15 lines) ----------
# -*- coding: utf-8 -*-
import json, clr
clr.AddReference('ProtoGeometry')
from Autodesk.DesignScript.Geometry import Point

file_path = IN[0]
with open(file_path, 'r', encoding='utf-8') as f:
    data = json.load(f)

pts = []
for b in data.get('beams', []):
    x = float(b['EndX']) / 304.8
    y = float(b['EndY']) / 304.8
    pts.append(Point.ByCoordinates(x, y, 0.0))
OUT = pts
# ----------------------------------------
n3_khớp_295_familysymbol = Python(IN[0]=file_path_cad_json_model)  # "3. Khớp 295 FamilySymbol"; CPython3
# ---------- n3_khớp_295_familysymbol.python (24 lines) ----------
# -*- coding: utf-8 -*-
import json, clr
clr.AddReference('RevitServices')
clr.AddReference('RevitAPI')
from Autodesk.Revit.DB import *
from RevitServices.Persistence import DocumentManager

file_path = IN[0]
with open(file_path, 'r', encoding='utf-8') as f:
    data = json.load(f)

doc = DocumentManager.Instance.CurrentDBDocument
type_names = [b['TypeName'] for b in data.get('beams', [])]

collector = FilteredElementCollector(doc).OfClass(FamilySymbol).OfCategory(BuiltInCategory.OST_StructuralFraming)
symbol_map = {s.Name: s for s in collector}

symbols = []
for name in type_names:
    sym = symbol_map.get(name)
    if sym and not sym.IsActive:
        sym.Activate()
    symbols.append(sym)
OUT = symbols
# ----------------------------------------
n4_lấy_295_mã_mark = Python(IN[0]=file_path_cad_json_model)  # "4. Lấy 295 Mã Mark"; CPython3
# ---------- n4_lấy_295_mã_mark.python (8 lines) ----------
# -*- coding: utf-8 -*-
import json

file_path = IN[0]
with open(file_path, 'r', encoding='utf-8') as f:
    data = json.load(f)

OUT = [str(b['Mark']) for b in data.get('beams', [])]
# ----------------------------------------
n5_lấy_295_cao_độ_z_offset = Python(IN[0]=file_path_cad_json_model)  # "5. Lấy 295 Cao Độ Z-Offset"; CPython3
# ---------- n5_lấy_295_cao_độ_z_offset.python (9 lines) ----------
# -*- coding: utf-8 -*-
import json

file_path = IN[0]
with open(file_path, 'r', encoding='utf-8') as f:
    data = json.load(f)

# Quy đổi ZOffset từ mm sang Feet cho Revit
OUT = [float(b.get('ZOffsetMm', 0)) / 304.8 for b in data.get('beams', [])]
# ----------------------------------------

# group: 2. HÌNH HỌC TIM DẦM & LEVEL (GEOMETRY & LEVEL)
byStartPointEndPoint = Line.ByStartPointEndPoint(startPoint=n1_tạo_295_điểm_đầu_start_points, endPoint=n2_tạo_295_điểm_cuối_end_points)
levels_tầng_1 = Levels("Tầng 1")

# group: 3. KHỞI TẠO CẤU KIỆN DẦM REVIT (BEAM BY CURVE)
beamByCurve = StructuralFraming.BeamByCurve(curve=byStartPointEndPoint, level=levels_tầng_1, structuralFramingType=n3_khớp_295_familysymbol)

# group: 4. CHUỖI GÁN THAM SỐ TỰ ĐỘNG (MARK, TOP, ORIGIN, Z-OFFSET)
codeblock_mark = CodeBlock { "Mark"; }
element_setparameterbyname_mark = Element.SetParameterByName(element=beamByCurve, parameterName=codeblock_mark, value=n4_lấy_295_mã_mark)
codeblock_z_justification = CodeBlock { "z Justification"; }
codeblock_0 = CodeBlock { 0; }
element_setparameterbyname_z = Element.SetParameterByName(element=element_setparameterbyname_mark, parameterName=codeblock_z_justification, value=codeblock_0)  # "Element.SetParameterByName (z Justification)"
codeblock_y_justification = CodeBlock { "y Justification"; }
codeblock_2 = CodeBlock { 2; }
element_setparameterbyname_y = Element.SetParameterByName(element=element_setparameterbyname_z, parameterName=codeblock_y_justification, value=codeblock_2)  # "Element.SetParameterByName (y Justification)"
codeblock_z_offset_value = CodeBlock { "z Offset Value"; }
element_setparameterbyname_z_2 = Element.SetParameterByName(element=element_setparameterbyname_y, parameterName=codeblock_z_offset_value, value=n5_lấy_295_cao_độ_z_offset)  # "Element.SetParameterByName (z Offset Value)"

# group: 5. KHÓA NÚT LIÊN KẾT & BẢNG NGHIỆM THU (DISALLOW JOIN & WATCH)
khóa_nút_liên_kết_2_đầu_python = Python(IN[0]=element_setparameterbyname_z_2)  # CPython3
# ---------- khóa_nút_liên_kết_2_đầu_python.python (19 lines) ----------
# -*- coding: utf-8 -*-
import clr
clr.AddReference('RevitAPI')
from Autodesk.Revit.DB.Structure import StructuralFramingUtils

beams = UnwrapElement(IN[0]) if isinstance(IN[0], list) else [UnwrapElement(IN[0])]
count = 0
for b in beams:
    if b:
        StructuralFramingUtils.DisallowJoinAtEnd(b, 0)
        StructuralFramingUtils.DisallowJoinAtEnd(b, 1)
        count += 1

OUT = {
    'status': 'SUCCESS',
    'totalBeams': len(beams),
    'disallowJoinApplied': count,
    'message': f'Đã khóa liên kết 2 đầu thành công cho {count} dầm đà kiềng Tầng 1!'
}
# ----------------------------------------
bảng_nghiệm_thu_hệ_dầm = Watch(khóa_nút_liên_kết_2_đầu_python)  # graph output
